# Grasshopper definition FacadeIterations.gh (Grasshopper 0.9.76)

number_slider = Slider(1, range=0..1)
construct_domain = ConstructDomain(DomainStart=expr("-x", number_slider), DomainEnd=number_slider)
square = Square(Plane=PlaneXY(0, 0, 0), Size=1, ExtentX=Slider(2, range=0..50), ExtentY=Slider(1, range=0..1))  # -> Cells, Points
rectangle = Rectangle(Plane=PlaneXY(0, 0, 0), XSize=construct_domain, YSize=construct_domain, Radius=0)  # -> Rectangle, Length
curve = Curve(square.Cells)
area = Area(Geometry=rectangle.Rectangle)  # -> Area, Centroid
list_item = ListItem(List=curve, Index=Slider(0, range=0..1), Wrap=True)
list_item_2 = ListItem(List=square.Points, Index=Slider(0, range=0..2), Wrap=True)
list_item_3 = ListItem(List=square.Points, Index=Slider(1, range=0..2), Wrap=True)
list_item_4 = ListItem(List=square.Points, Index=Slider(2, range=0..2), Wrap=True)
list_item_5 = ListItem(List=flatten(list_item_2), Index=Slider(0, range=0..1), Wrap=True)
panel = Panel("""{0;0;1}(+1)
{0;0;1}(-1)""")
boolean_toggle = BooleanToggle(False)
relative_item = RelativeItem(Tree=square.Points, Offset=panel, WrapPaths=boolean_toggle, WrapItems=boolean_toggle)  # -> ItemA, ItemB
path_mapper = PathMapper(square.Points, source="{A;B;C}", target="{A;B;C}")
line = Line(StartPoint=relative_item.ItemA, EndPoint=relative_item.ItemB)
list_item_6 = ListItem(List=line, Index=Slider(0, range=0..1), Wrap=True)
list_item_7 = ListItem(List=line, Index=Slider(1, range=0..1), Wrap=True)
cull_pattern = CullPattern(List=flatten(list_item_6), CullPattern=[True, False])
cull_pattern_2 = CullPattern(List=flatten(list_item_7), CullPattern=[True, False])
