# Grasshopper definition FacadeIterationsTwo.gh (Grasshopper 0.9.76)
# plug-ins: Python Interpreter, Weaverbird, Kangaroo2 Components

xy = XYPlane(Origin=Point(0, 0, 0))
xz = XZPlane(Origin=Point(0, 0, 0))
hexagonal = Hexagonal(Plane=xz, Size=Slider(1, range=0..1), ExtentX=Slider(1, range=0..10), ExtentY=Slider(1, range=0..10))  # -> Cells, simplify(Points)
simplifybranches = CSharpScript(points=hexagonal.Points)  # -> pointsOut; inputs points: tree of Point3d
# ---------- simplifybranches: C# ----------
    int size = points.BranchCount;
    
    var finalPoints = new DataTree<Point3d>();
    
    for( int i = 0; i < size; ++i )
      for( int j = 0; j < points.Branch(i).Count; ++j )
      {
      
        finalPoints.Add( points.Branch(i)[j], new GH_Path(i) );
      
      }
    
    pointsOut = finalPoints;
# ---------- end simplifybranches ----------
number_slider = Slider(2, range=0..50)
number_slider_2 = Slider(2, range=0..10)
flatten = FlattenTree(Tree=hexagonal.Cells, Path="{0}")
point = Point(simplify(flatten(simplifybranches)))
xz_2 = XZPlane(Origin=Point(0, 0, 0))
xz_3 = XZPlane(Origin=Point(0, 0, 0))
graft = GraftTree(Tree=point, IncludeEmptyLists=True, IncludeNullItems=True)  # -> simplify(Tree)
square = Square(Plane=xz_2, Size=1, ExtentX=number_slider, ExtentY=number_slider)  # -> Cells, Points
addition = Addition(A=number_slider_2, B=number_slider)
number_slider_3 = Slider(0.934464, range=0..1)
c_script = CSharpScript(point=graft, direction=Slider(4, range=0..10))  # -> simplify(A); inputs point: tree of Point3d, direction: Int32
# ---------- c_script: C# ----------
    var vectorDir = new Point3d(0, 0, 0);

    if( direction > direction % 3 ) direction = direction % 3;

    switch( direction )
    {

      case 0: vectorDir = new Point3d(1, 0, 0);
        break;

      case 1: vectorDir = new Point3d(0, 1, 0);
        break;

      case 2: vectorDir = new Point3d(0, 0, 1);
        break;

    }

    var dataTreeOut = new DataTree<Plane>();

    for( int i = 0; i < point.BranchCount; ++i )
      for( int j = 0; j < point.Branch(i).Count; ++j )
      {

        dataTreeOut.Add(new Plane(point.Branch(i)[j], new Vector3d(vectorDir)), new GH_Path(i));
        //dataTreeOut.Graft(new GH_Path(counter), true);

      }

    A = dataTreeOut;
# ---------- end c_script ----------
subtraction = Subtraction(A=addition, B=number_slider_2)
points = PointList(Points=square.Points)
panel = Panel(square.Points)

# ---- group: SomeComponentsWeMightOrMightNotNeed
point_2 = Point(square.Points)  # disabled
meshing = CSharpScript()  # -> Mesh; inputs points: list of Point3d; disabled
# ---------- meshing: C# ----------
    var mesh = new Mesh();

    mesh.Vertices.AddVertices(points);

    //for( int i = 0; i < 2; ++i )
    //{

      mesh.Faces.AddFace( 4, 1, 0 );

      mesh.Faces.AddFace( 4, 2, 1 );

      mesh.Faces.AddFace( 4, 2, 5 );
      
      mesh.Faces.AddFace( 4, 5, 8 );
    
      mesh.Faces.AddFace( 4, 8, 7 );
    
      mesh.Faces.AddFace( 4, 7, 6 );

      mesh.Faces.AddFace( 4, 6, 3 );
    
      mesh.Faces.AddFace( 4, 0, 3 );
    
    //}

    Mesh = mesh;
# ---------- end meshing ----------
mesher = CSharpScript()  # -> meshOut, A; inputs points: list of Point3d, dis: Double; disabled
# ---------- mesher: C# ----------
    var mesh = new Mesh();

    int size = points.Count;

    var organized = Point3d.SortAndCullPointList(points, 0.001);

    mesh.Vertices.AddVertices(organized);

    double distance = organized[0].DistanceTo(organized[1]);

    if( AlmostEqualTo( distance, dis ) == false )
    {

      mesh.Faces.AddFace(0, 1, 12);
      mesh.Faces.AddFace(0, 1, 2);
      mesh.Faces.AddFace(0, 2, 3, 4);
      mesh.Faces.AddFace(0, 4, 5);
      mesh.Faces.AddFace(0, 5, 6);
      mesh.Faces.AddFace(0, 6, 7);
      mesh.Faces.AddFace(0, 7, 8);
      mesh.Faces.AddFace(0, 8, 9, 10);
      mesh.Faces.AddFace(0, 10, 11);
      mesh.Faces.AddFace(0, 11, 12);

    }

    else
    {

      mesh.Faces.AddFace(12, 0, 1);
      mesh.Faces.AddFace(12, 1, 2);
      mesh.Faces.AddFace(12, 2, 3, 4);
      mesh.Faces.AddFace(12, 4, 5);
      mesh.Faces.AddFace(12, 5, 6);
      mesh.Faces.AddFace(12, 6, 7);
      mesh.Faces.AddFace(12, 7, 8);
      mesh.Faces.AddFace(12, 8, 9, 10);
      mesh.Faces.AddFace(12, 10, 11);
      mesh.Faces.AddFace(12, 11, 0);

    }

    meshOut = mesh;

    A = organized;
# ---------- mesher: C# additional code ----------
  public static bool AlmostEqualTo(double value1, double value2)
  {
    return Math.Abs(value1 - value2) < 0.0000001; 
  }
# ---------- end mesher ----------
number_slider_4 = Slider(0, range=0..100)  # disabled
c_script_2 = CSharpScript()  # -> A; inputs points: list of Point3d; disabled
# ---------- c_script_2: C# ----------
    var pointsOut = new List<Point3d>();
    
    var size = points.Count;
    
    for( int i = 0; i < size; ++i )
    {
      
      if( i % 3 != 1 )
      {
        
        pointsOut.Add( points[i] );
      
      }
      
    }
    
    A = pointsOut;
# ---------- end c_script_2 ----------
boolean_toggle = BooleanToggle(True)  # disabled
c_script_3 = CSharpScript(points=point_2)  # -> selectedPoints; inputs points: tree of Point3d; disabled
# ---------- c_script_3: C# ----------
    var pointsOut = new DataTree<Point3d>();

    int branches = points.BranchCount;

    for( int i = 0; i < branches; ++i )
    {

      var path = new GH_Path(i);

      for( int j = 0; j < points.Branch(i).Count; ++j )
      {


        if( i % 2 != 0 && j % 2 != 0 )

          pointsOut.Add(points.Branch(i)[j], path);


      }

    }

    selectedPoints = pointsOut;
# ---------- end c_script_3 ----------
c_script_4 = CSharpScript(Reference="C:\Users\feli2\AppData\Roaming\Grasshopper\Libraries\KangarooSolver.dll")  # -> out, A, B; inputs x: list; disabled
# ---------- c_script_4: C# ----------
    
    var PS = new KangarooSolver.PhysicalSystem();
    double tol = 0.0001; // points closer than this will get combined into a single particle
    var GoalList = new List<IGoal>();

    //Assign indexes to the particles in each Goal:
    foreach(IGoal G in x)
    {
      PS.AssignPIndex(G, tol);
      GoalList.Add(G);
    }

    int counter = 0;
    double threshold = 1e-10;
    do
    {
      PS.Step(GoalList, false, threshold); // The step will iterate until either reaching 15ms or the energy threshold
      counter++;
    }while(PS.GetvSum() > threshold && counter < 100); //GetvSum returns the current kinetic energy
    // always include a counter to prevent it getting stuck forever in case it cannot reach the given threshold

    A = PS.GetOutput(GoalList);
    B = counter;
# ---------- end c_script_4 ----------
path = ConstructPath(Indices=number_slider_4)  # disabled
branch = TreeBranch(Path=path, MaintainPaths=True)  # disabled
getmebranches = CSharpScript(tree=square.Points, clockWise=boolean_toggle)  # -> A; inputs tree: tree of Point3d, clockWise: Boolean; disabled
# ---------- getmebranches: C# ----------
    var linesOut = new DataTree<Point3d>();

    var branches = tree.BranchCount;

    int x = 0, y = 0;

    bool flag = clockWise;

    if( flag == true )
    {

      x = 0; y = 1;

    }

    if( flag == false )
    {

      x = 1; y = 0;

    }

    for( int i = 0; i < branches; ++i )
      for( int j = 0; j < tree.Branch(i).Count; ++j )
      {

        var path = new GH_Path(i);

        if( i % 2 != 0 && j % 2 != x )
          if( flag == true )

            linesOut.Add(tree.Branch(i)[j], path);

          else
          {

            linesOut.Add(tree.Branch(i)[j], path);

          }

        if( i % 2 != 1 && j % 2 != y )
          if( flag == true )

            linesOut.Add(tree.Branch(i)[j], path);

          else
          {

            linesOut.Add(tree.Branch(i)[j], path);

          }

      }

    A = linesOut;
# ---------- end getmebranches ----------
unit_z = UnitZ(Factor=1)  # disabled
c_script_5 = CSharpScript(points=branch)  # -> meshOut, A; inputs points: list of Point3d; disabled
# ---------- c_script_5: C# ----------
    var mesh = new Mesh();

    int size = points.Count;

    var organized = Point3d.SortAndCullPointList(points, 0.001);

    mesh.Vertices.AddVertices(organized);

    mesh.Faces.AddFace(0, 1, 12);
    mesh.Faces.AddFace(0, 1, 2);
    mesh.Faces.AddFace(0, 2, 3, 4);
    mesh.Faces.AddFace(0, 4, 5);
    mesh.Faces.AddFace(0, 5, 6);
    mesh.Faces.AddFace(0, 6, 7);
    mesh.Faces.AddFace(0, 7, 8);
    mesh.Faces.AddFace(0, 8, 9, 10);
    mesh.Faces.AddFace(0, 10, 11);
    mesh.Faces.AddFace(0, 11, 12);
    
    /*
    for( int i = 0; i < size; ++i )
    {

      mesh.Faces.AddFace(0, i + 1, i + 2, i + 3);

      //if( i == size - 1 )

        //mesh.Faces.AddFace(0, 1, size - 1);

    }
    */

    meshOut = mesh;

    A = organized;
# ---------- end c_script_5 ----------
number_slider_5 = Slider(0.1407, range=0..1)  # disabled
number_slider_6 = Slider(1, range=0..1)  # disabled
move = Move(Geometry=c_script_3, Motion=unit_z)  # -> Geometry, Transform; disabled
goalsbrancher = CSharpScript(Reference="C:\Users\feli2\AppData\Roaming\Grasshopper\Libraries\KangarooSolver.dll")  # -> A; inputs goals: tree; disabled
# ---------- goalsbrancher: C# ----------
    PS = new KangarooSolver.PhysicalSystem();
    
    for( int i = 0; i < goals.BranchCount; ++i )
      for( int j = 0; j < goals.Branch(i).Count; ++j )
      {

        goalsOut.Add(goals.Branch(i)[j], new GH_Path(i));

      }

    /*
    for( int i = 0; i < goals.Count; ++i )
    {

      goalsOut.Add(goals[i], new GH_Path(i));

    }
    */

    A = goalsOut;
# ---------- goalsbrancher: C# additional code ----------
  KangarooSolver.PhysicalSystem PS = new KangarooSolver.PhysicalSystem();
  DataTree<object> goalsOut = new DataTree<object>();
# ---------- end goalsbrancher ----------
points_2 = PointList(Points=c_script_5.A, Size=number_slider_5)  # disabled
customiteration = CSharpScript(Reference="D:\DOWNLOADS\KANGAROO242\KangarooSolver.dll")  # -> out, A, B; inputs x: list; disabled
# ---------- customiteration: C# ----------
    var PS = new KangarooSolver.PhysicalSystem();
    double tol = 0.0001; // points closer than this will get combined into a single particle
    var GoalList = new List<IGoal>();

    //Assign indexes to the particles in each Goal:
    foreach(IGoal G in x)
    {
      PS.AssignPIndex(G, tol);
      GoalList.Add(G);
    }

    int counter = 0;
    double threshold = 1e-10;
    do
    {
      PS.Step(GoalList, false, threshold); // The step will iterate until either reaching 15ms or the energy threshold
      counter++;
    }while(PS.GetvSum() > threshold && counter < 100); //GetvSum returns the current kinetic energy
    // always include a counter to prevent it getting stuck forever in case it cannot reach the given threshold

    A = PS.GetOutput(GoalList);
    B = counter;
# ---------- end customiteration ----------
point_list = PointList(Points=getmebranches, Size=number_slider_6)  # disabled
point_list_2 = PointList(Points=c_script_3, Size=number_slider_6)  # disabled

# ----
polygon = Polygon(Plane=c_script, Radius=number_slider_3, Segments=Slider(6, range=0..100), FilletRadius=0)  # -> Polygon, Length

# ---- group: ThisAintThePrettiestButItGetsThingsDone
boolean_toggle_2 = BooleanToggle(False)
relative_item = RelativeItem(Tree=square.Points, Offset="{0;0;1}", WrapPaths=boolean_toggle_2, WrapItems=boolean_toggle_2)  # -> ItemA, ItemB
relative_item_2 = RelativeItem(Tree=square.Points, Offset="{0;0;0}[+1]", WrapPaths=boolean_toggle_2, WrapItems=boolean_toggle_2)  # -> ItemA, ItemB
relative_item_3 = RelativeItem(Tree=square.Points, Offset="{0;0;+1}[+1]", WrapPaths=boolean_toggle_2, WrapItems=boolean_toggle_2)  # -> ItemA, ItemB
relative_item_4 = RelativeItem(Tree=square.Points, Offset="{0;0;1}(-1)", WrapPaths=boolean_toggle_2, WrapItems=boolean_toggle_2)  # -> ItemA, ItemB

# ----
radians = Radians(Degrees=Slider(0, range=0..1000))
rotate = Rotate(Geometry=polygon.Polygon, Angle=1.570796327, Plane=c_script)  # -> simplify(Geometry), Transform
discontinuity = Discontinuity(Curve=simplify(rotate.Geometry), Level=1)  # -> simplify(Points), simplify(Parameters)
area = Area(Geometry=rotate.Geometry)  # -> Area, Centroid
branchrearrange = CSharpScript(points=discontinuity.Points)  # -> A; inputs points: tree of Point3d
# ---------- branchrearrange: C# ----------
    var pointsOut = new DataTree<Point3d>();

    for( int i = 0; i < points.BranchCount; ++i )
      for( int j = 0; j < points.Branch(i).Count; ++j )
      {

        pointsOut.Add(points.Branch(i)[j], new GH_Path(i));

      }

    A = pointsOut;
# ---------- end branchrearrange ----------
line = Line(StartPoint=graft(point), EndPoint=branchrearrange)  # -> simplify(Line)

# ---- group: GiveMeThemLines
line_2 = Line(StartPoint=relative_item_3.ItemA, EndPoint=relative_item_3.ItemB)  # -> simplify(Line)
line_3 = Line(StartPoint=relative_item_4.ItemA, EndPoint=relative_item_4.ItemB)  # -> simplify(Line)
line_4 = Line(StartPoint=relative_item_2.ItemA, EndPoint=relative_item_2.ItemB)  # -> simplify(Line)
line_5 = Line(StartPoint=relative_item.ItemA, EndPoint=relative_item.ItemB)  # -> simplify(Line)
c_script_6 = CSharpScript(lines=line_4)  # -> linesOut; inputs lines: tree of Line
# ---------- c_script_6: C# ----------
    int branches = lines.BranchCount;

    var newLines = new DataTree<Line>();
    
    var p = new int[branches];
    
    for( int i = 0; i < branches; ++i )
    {

      for( int j = 0; j < lines.Branch(i).Count; ++j )
      {

        if( i % 2 != 1 )
        {

          newLines.Add(lines.Branch(i)[j], new GH_Path(i/2));

        }
        
      }

    }

    linesOut = newLines;
# ---------- end c_script_6 ----------
getmebranches_2 = CSharpScript(tree=line_2, clockWise=Toggle(True))  # -> A; inputs tree: tree of Line, clockWise: Boolean
# ---------- getmebranches_2: C# ----------
    var linesOut = new DataTree<Line>();

    var branches = tree.BranchCount;

    int x = 0, y = 0;

    bool flag = clockWise;

    if( flag == true )
    {

      x = 0; y = 1;

    }

    if( flag == false )
    {

      x = 1; y = 0;

    }

    for( int i = 0; i < branches; ++i )
      for( int j = 0; j < tree.Branch(i).Count; ++j )
      {

        var path = new GH_Path(i);

        if( i % 2 != 0 && j % 2 != x )
          if( flag == true )

            linesOut.Add(tree.Branch(i)[j], path);

          else
          {

            linesOut.Add(tree.Branch(i)[j], path);

          }

        if( i % 2 != 1 && j % 2 != y )
          if( flag == true )

            linesOut.Add(tree.Branch(i)[j], path);

          else
          {

            linesOut.Add(tree.Branch(i)[j], path);

          }

      }

    A = linesOut;
# ---------- end getmebranches_2 ----------
getmebranches_3 = CSharpScript(tree=line_3, clockWise=Toggle(False))  # -> A; inputs tree: tree of Line, clockWise: Boolean; same code as getmebranches_2

# ----
shatter = Shatter(Curve=rotate.Geometry, Parameters=discontinuity.Parameters)  # -> simplify(Segments)
branchrearrange_2 = CSharpScript(lines=line)  # -> A; inputs lines: tree of Line
# ---------- branchrearrange_2: C# ----------
    var linesOut = new DataTree<Line>();
    
    for( int i = 0; i < lines.BranchCount; ++i )
      for( int j = 0; j < lines.Branch(i).Count; ++j )
      {
      
        linesOut.Add( lines.Branch(i)[j], new GH_Path(i) );
      
      }
    
    A = linesOut;
# ---------- end branchrearrange_2 ----------
branchrearrange_3 = CSharpScript(lines=shatter)  # -> A; inputs lines: tree of Line; same code as branchrearrange_2
c_script_7 = CSharpScript(points=area.Centroid)  # -> selectedPoints; inputs points: tree of Point3d
# ---------- c_script_7: C# ----------
    var pointsOut = new DataTree<Point3d>();

    int size = points.BranchCount;

    for( int i = 0; i < size; ++i )
    {

      for( int j = 0; j < points.Branch(i).Count; ++j )

        //if( i % size != 0 )

          pointsOut.Add(points.Branch(i)[j], new GH_Path(i));

    }

    selectedPoints = pointsOut;
# ---------- end c_script_7 ----------
panel_2 = Panel(branchrearrange_3)
evaluate_curve = EvaluateCurve(Curve=reparameterize(branchrearrange_3), Parameter=Slider(0.5, range=0..1))  # -> Point, Tangent, Angle
c_script_8 = CSharpScript(points=evaluate_curve.Point)  # -> selectedPoints; inputs points: tree of Point3d; same code as c_script_7

# ---- group: LadybugFly
toggle = BooleanToggle(True)  # disabled
open_weather_file = Ladybug_OpenEPWWeatherFile(open=toggle)  # -> epwFile; disabled; plug-in component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
ladybug = Ladybug_Ladybug()  # -> Vviiiiiiiiiizzz; disabled; plug-in component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
importepw = Ladybug_ImportEpw(epwFile=open_weather_file)  # -> readMe, latitude, location, dryBulbTemperature, dewPointTemperature, relativeHumidity, windSpeed, windDirection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; disabled; plug-in component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
number_slider_7 = Slider(0.1, range=0..0.1)  # disabled
number_slider_8 = Slider(12, range=0..100)  # disabled
number_slider_9 = Slider(31, range=0..100)  # disabled
number_slider_10 = Slider(12, range=0..100)  # disabled
number_slider_11 = Slider(1, range=0..1)  # disabled
sunpath = Ladybug_SunPath(
    location=importepw.location,
    hour=number_slider_8,
    day=number_slider_9,
    month=number_slider_10,
    timeStep=number_slider_11,
    sunPathScale=number_slider_7,
    dailyOrAnnualSunPath=True)  # -> readMe, sunVectors, sunAltitudes, sunAzimuths, port, sunSpheresMesh, sunPathCrvs, compassCrvs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; disabled; plug-in component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
mesh = Mesh()  # disabled
pt = Point()  # disabled
Y = UnitY(Factor=1)  # disabled
c_script_9 = CSharpScript(points=pt)  # -> flatten(selectedPoints); inputs points: tree of Point3d; disabled; same code as c_script_3
medges = MeshEdges()  # -> NakedEdges, InteriorEdges, NonManifoldEdges; disabled
move_2 = Move(Geometry=c_script_9, Motion=Vector(0, 0, 10))  # -> Geometry, Transform; disabled
move_3 = Move(Geometry=c_script_9, Motion=Y)  # -> Geometry, Transform; disabled
pt_2 = Point(sunpath.sunPositions)  # disabled
number_slider_12 = Slider(0, range=0..1)  # disabled
line_6 = Line(medges.InteriorEdges)  # disabled
vec2pt = Vector2Pt(PointA=move_3.Geometry, PointB=c_script_9, Unitize=False)  # -> Vector, Length; disabled
eval = EvaluateCurve(Curve=line_6, Parameter=number_slider_12)  # -> Point, Tangent, Angle; disabled
vdis = VectorDisplay(Anchor=c_script_9, Vector=vec2pt.Vector)  # disabled
meshray = MeshRay(Mesh=mesh, Point=c_script_9, Direction=vec2pt.Vector)  # -> Point, Hit; disabled
cp = ClosestPoint(Point=meshray.Point, Cloud=eval.Point)  # -> ClosestPoint, CPIndex, Distance; disabled
lng = ListLength(List=cp.ClosestPoint)  # disabled
series = Series(Start=0, Step=1, Count=lng)  # disabled
X = UnitX(Factor=series)  # disabled
move_4 = Move(Geometry=pt_2, Motion=X)  # -> Geometry, Transform; disabled
vec2pt_2 = Vector2Pt(PointA=pt_2, PointB=[cp.ClosestPoint, move_2.Geometry], Unitize=False)  # -> Vector, Length; disabled
vdis_2 = VectorDisplay(Anchor=pt_2, Vector=vec2pt_2.Vector)  # disabled

# ---- group: GiveMeAMesh
line_7 = Line([line_5, getmebranches_2, getmebranches_3, c_script_6])
weaverbird_s_mesh_from_lines_weave_back = WeaverbirdsMeshFromLinesWeaveBack(Lines=flatten(line_7), MaximumValence=Slider(4, range=0..5))

# ----
line_8 = Line(StartPoint=c_script_7, EndPoint=c_script_8)
c_script_10 = CSharpScript(points=evaluate_curve.Point)  # -> selectedPoints; inputs points: list of Point3d
# ---------- c_script_10: C# ----------
    var pointsOut = new List<Point3d>();

    int size = points.Count;

    for( int i = 0; i < size; ++i )
    {
      if( i % 5 != 0 )

        //if( i % 3 != 0 )
        
        pointsOut.Add(points[i]);

    }

    selectedPoints = pointsOut;
# ---------- end c_script_10 ----------
line_9 = Line(StartPoint=graft(point), EndPoint=c_script_10)
branchrearrange_4 = CSharpScript(lines=line_8)  # -> A; inputs lines: tree of Line; same code as branchrearrange_2
ln = Line(StartPoint=area.Centroid, EndPoint=c_script_10)
points_3 = PointList(Points=c_script_10, Size=Slider(0.408, range=0..1))

# ---- group: AnchorPointsWeWantThemFixed
c_script_11 = CSharpScript(lines=line_4)  # -> linesOut; inputs lines: tree of Line
# ---------- c_script_11: C# ----------
    int branches = lines.BranchCount;

    var newLines = new DataTree<Line>();

    for( int i = 0; i < branches; ++i )
      for( int j = 0; j < lines.Branch(i).Count; ++j )
      {

        var path = new GH_Path(i);

        if( i % 2 != 0 )

          newLines.Add(lines.Branch(i)[j], path);

      }

    linesOut = newLines;
# ---------- end c_script_11 ----------
c_script_12 = CSharpScript(lines=line_5)  # -> linesOut; inputs lines: tree of Line
# ---------- c_script_12: C# ----------
    int branches = lines.BranchCount;

    var newLines = new DataTree<Line>();

    var p = new int[branches];

    for( int i = 0; i < branches; ++i )
    {

      for( int j = 0; j < lines.Branch(i).Count; ++j )
      {

        if( j % 2 != 1 )
        {

          newLines.Add(lines.Branch(i)[j], new GH_Path(j/2));

        }

      }

    }

    linesOut = newLines;
# ---------- end c_script_12 ----------
join = JoinCurves(Curves=c_script_11, Preserve=False)
join_2 = JoinCurves(Curves=c_script_12, Preserve=False)
join_3 = JoinCurves(Curves=c_script_6, Preserve=False)
end = EndPoints(Curve=join)  # -> Start, End
ccx = CurveCurve(CurveA=flatten(join_2), CurveB=join_3)  # -> flatten(Points), ParamsA, ParamsB
pt_3 = Point(flatten([end.Start, end.End, ccx.Points]))

# ----
crv = Curve([branchrearrange_4, branchrearrange_3])
eval_2 = EvaluateCurve(Curve=reparameterize(crv), Parameter=Slider(1, range=0..1))  # -> Point, Tangent, Angle
multiplication = Multiplication(A=number_slider_3, B=0.5)
pt_4 = Point([eval_2.Point, area.Centroid])
meshertree = CSharpScript(points=pt_4, dis=multiplication)  # -> simplify(graft(meshOut)); inputs points: tree of Point3d, dis: Double
# ---------- meshertree: C# ----------
    int size = points.BranchCount;

    var mesh = new Mesh[size];

    var organized = new Point3d[size][];

    for( int i = 0; i < size; ++i )
    {

      organized[i] = Point3d.SortAndCullPointList(points.Branch(i), 0.001);

      double distance = organized[i][0].DistanceTo(organized[i][1]);
      
      mesh[i] = new Mesh();
      mesh[i].Vertices.AddVertices(organized[i]);

      if( AlmostEqualTo(distance, dis) == false )
      {

        mesh[i].Faces.AddFace(0, 1, 12);
        mesh[i].Faces.AddFace(0, 1, 2);
        mesh[i].Faces.AddFace(0, 2, 3, 4);
        mesh[i].Faces.AddFace(0, 4, 5);
        mesh[i].Faces.AddFace(0, 5, 6);
        mesh[i].Faces.AddFace(0, 6, 7);
        mesh[i].Faces.AddFace(0, 7, 8);
        mesh[i].Faces.AddFace(0, 8, 9, 10);
        mesh[i].Faces.AddFace(0, 10, 11);
        mesh[i].Faces.AddFace(0, 11, 12);

      }

      else
      {

        mesh[i].Faces.AddFace(12, 0, 1);
        mesh[i].Faces.AddFace(12, 1, 2);
        mesh[i].Faces.AddFace(12, 2, 3, 4);
        mesh[i].Faces.AddFace(12, 4, 5);
        mesh[i].Faces.AddFace(12, 5, 6);
        mesh[i].Faces.AddFace(12, 6, 7);
        mesh[i].Faces.AddFace(12, 7, 8);
        mesh[i].Faces.AddFace(12, 8, 9, 10);
        mesh[i].Faces.AddFace(12, 10, 11);
        mesh[i].Faces.AddFace(12, 11, 0);

      }

    }

    meshOut = mesh;
# ---------- meshertree: C# additional code ----------
  public static bool AlmostEqualTo(double value1, double value2)
  {
    return Math.Abs(value1 - value2) < 0.0000001; 
  }
# ---------- end meshertree ----------
branchrearrange_5 = CSharpScript(mesh=meshertree)  # -> A; inputs mesh: tree of Mesh
# ---------- branchrearrange_5: C# ----------
    var meshOut = new DataTree<Mesh>();

    for( int i = 0; i < mesh.BranchCount; ++i )
      for( int j = 0; j < mesh.Branch(i).Count; ++j )
      {

        meshOut.Add(mesh.Branch(i)[j], new GH_Path(i));

      }

    A = meshOut;
# ---------- end branchrearrange_5 ----------
lng_2 = ListLength(List=flatten)
addition_2 = Addition(A=subtraction, B=Slider(0.08106, range=0..1))
folding = Slider(6.645, range=0..10)
folding_2 = Slider(4.277, range=0..10)
mesh_2 = Mesh(simplify(branchrearrange_5))
angle = Panel("pi")
angle_2 = Panel("-pi")
crv_2 = Curve(branchrearrange_2)
X_2 = UnitX(Factor=addition_2)
crv_3 = Curve(crv)
crv_4 = Curve([getmebranches_2, getmebranches_3])
multiplication_2 = Multiplication(A=angle_2, B=folding)
move_5 = Move(Geometry=crv_4, Motion=X_2)  # -> Geometry, Transform
crv_5 = Curve([line_5, c_script_6])
multiplication_3 = Multiplication(A=angle_2, B=folding_2)
dom = ConstructDomain(DomainStart=0, DomainEnd=multiplication_3)
random = Random(Range=dom, Number=lng_2, Seed=Slider(556, range=0..1000))  # -> simplify(graft(Random))
move_6 = Move(Geometry=crv_5, Motion=X_2)  # -> Geometry, Transform
# You can replace the mesh with a different
# pattern, and choose edges from it to assign
# to mountain or valley folds.
# To start, Press the 'Reset' button below  then slowly change the 'Folding' slider.
move_7 = Move(Geometry=weaverbird_s_mesh_from_lines_weave_back, Motion=X_2)  # -> Geometry, Transform
panel_3 = Panel(random)
folding_3 = Slider(0.99, range=0..0.99)
folding_4 = Slider(0.99, range=0..0.99)
X_3 = UnitX(Factor=Slider(1.414, range=0..10))

# ---- group: mesh of flat folding pattern
mesh_3 = Mesh(simplify(graft([weaverbird_s_mesh_from_lines_weave_back, move_7.Geometry])))

# ---- group: Mountain fold lines
crv_6 = Curve([crv_4, move_5.Geometry])

# ----
angle_3 = Panel("pi")
angle_4 = Panel("-pi")

# ---- group: Valley fold lines
crv_7 = Curve([crv_5, move_6.Geometry])

# ----
move_8 = Move(Geometry=crv_2, Motion=X_3)  # -> Geometry, Transform
move_9 = Move(Geometry=crv_3, Motion=X_3)  # -> Geometry, Transform
move_10 = Move(Geometry=mesh_2, Motion=X_3)  # -> Geometry, Transform
Z = UnitZ(Factor=Slider(0.7952, range=0..2))
move_11 = Move(Geometry=move_8.Geometry, Motion=Z)  # -> Geometry, Transform
move_12 = Move(Geometry=move_9.Geometry, Motion=Z)  # -> Geometry, Transform
move_13 = Move(Geometry=move_10.Geometry, Motion=Z)  # -> Geometry, Transform
multiplication_4 = Multiplication(A=angle_3, B=folding_3)
multiplication_5 = Multiplication(A=angle_4, B=folding_3)

multiplication_6 = Multiplication(A=angle_3, B=folding_4)
hingepoints = HingePoints(Mesh=mesh_3)  # -> _1, _2, _3, _4
multiplication_7 = Multiplication(A=angle_4, B=folding_4)
ln_2 = Line(StartPoint=hingepoints._1, EndPoint=hingepoints._2)
hinge = Hinge(
    FoldStart=hingepoints._1,
    FoldEnd=hingepoints._2,
    Tip1=hingepoints._3,
    Tip2=hingepoints._4,
    RestAngle=simplify(graft([multiplication_6, multiplication_4])),
    Strength=0.1)
hinge_2 = Hinge(
    FoldStart=hingepoints._1,
    FoldEnd=hingepoints._2,
    Tip1=hingepoints._3,
    Tip2=hingepoints._4,
    RestAngle=simplify(graft([multiplication_7, multiplication_5])),
    Strength=0.1)
show = Show(G=mesh_3)
eval_3 = EvaluateCurve(Curve=reparameterize(crv_7), Parameter=0.5)  # -> Point, Tangent, Angle
eval_4 = EvaluateCurve(Curve=reparameterize(crv_6), Parameter=0.5)  # -> Point, Tangent, Angle
eval_5 = EvaluateCurve(Curve=ln_2, Parameter=0.5)  # -> graft(Point), Tangent, Angle
dist = Distance(PointA=eval_3.Point, PointB=eval_5.Point)
dist_2 = Distance(PointA=eval_4.Point, PointB=eval_5.Point)
sort = SortList(Keys=dist)  # -> Keys, ValuesA
sort_2 = SortList(Keys=dist_2)  # -> Keys, ValuesA
item = ListItem(List=sort.Keys, Index=0, Wrap=True)
item_2 = ListItem(List=sort_2.Keys, Index=0, Wrap=True)
smaller = SmallerThan(FirstNumber=item, SecondNumber=0.01)  # -> flatten(SmallerThan), OrEqualTo
smaller_2 = SmallerThan(FirstNumber=item_2, SecondNumber=0.01)  # -> flatten(SmallerThan), OrEqualTo
cull = CullPattern(List=hinge, CullPattern=smaller_2.SmallerThan)
cull_2 = CullPattern(List=hinge_2, CullPattern=smaller.SmallerThan)

num = Number([multiplication_3, multiplication_2])
mesh_4 = Mesh([mesh_2, move_13.Geometry])
crv_8 = Curve([crv_3, move_12.Geometry])
crv_9 = Curve([crv_2, move_11.Geometry])

# ---- group: maintain edge lengths
medges_2 = MeshEdges(Mesh=mesh_3)  # -> NakedEdges, InteriorEdges, NonManifoldEdges
length_line = LengthLine(Line=[medges_2.NakedEdges, medges_2.InteriorEdges], Strength=1)

# ---- group: a weak plastic anchor on all points prevents drift
demesh = DeconstructMesh(Mesh=mesh_3)  # -> Vertices, Faces, Colours, Normals
plasticanchor = PlasticAnchor(Point=demesh.Vertices, Limit=0.01, Strength=0.001)

# ----
hingepoints_2 = HingePoints(Mesh=mesh_4)  # -> _1, _2, _3, _4
medges_3 = MeshEdges(Mesh=mesh_4)  # -> simplify(NakedEdges), simplify(InteriorEdges), simplify(NonManifoldEdges)
demesh_2 = DeconstructMesh(Mesh=mesh_4)  # -> simplify(Vertices), Faces, Colours, Normals
ln_3 = Line(StartPoint=hingepoints_2._1, EndPoint=hingepoints_2._2)  # -> simplify(Line)
hinge_3 = Hinge(
    FoldStart=simplify(hingepoints_2._1),
    FoldEnd=simplify(hingepoints_2._2),
    Tip1=simplify(hingepoints_2._3),
    Tip2=simplify(hingepoints_2._4),
    RestAngle=simplify(graft(num)),
    Strength=0.1)  # -> simplify(Hinge)
hinge_4 = Hinge(
    FoldStart=simplify(hingepoints_2._1),
    FoldEnd=simplify(hingepoints_2._2),
    Tip1=simplify(hingepoints_2._3),
    Tip2=simplify(hingepoints_2._4),
    RestAngle=simplify(graft(num)),
    Strength=0.1)  # -> simplify(Hinge)
show_2 = Show(G=mesh_4)
eval_6 = EvaluateCurve(Curve=ln_3, Parameter=0.5)  # -> graft(Point), Tangent, Angle
eval_7 = EvaluateCurve(Curve=reparameterize(crv_8), Parameter=0.5)  # -> Point, Tangent, Angle
eval_8 = EvaluateCurve(Curve=reparameterize(crv_9), Parameter=0.5)  # -> Point, Tangent, Angle
plasticanchor_2 = PlasticAnchor(Point=demesh_2.Vertices, Limit=0.01, Strength=0.001)
length_line_2 = LengthLine(Line=[medges_3.NakedEdges, medges_3.InteriorEdges], Strength=1)
dist_3 = Distance(PointA=eval_7.Point, PointB=eval_6.Point)
dist_4 = Distance(PointA=eval_8.Point, PointB=eval_6.Point)
sort_3 = SortList(Keys=dist_3)  # -> Keys, ValuesA
sort_4 = SortList(Keys=dist_4)  # -> Keys, ValuesA
pt_5 = Point(simplify(branchrearrange))
pt_6 = Point(eval_2.Point)
item_3 = ListItem(List=sort_3.Keys, Index=0, Wrap=True)
item_4 = ListItem(List=sort_4.Keys, Index=0, Wrap=True)
organizepoints = CSharpScript(points=pt_6)  # -> simplify(A); inputs points: list of Point3d
# ---------- organizepoints: C# ----------
    A = Point3d.SortAndCullPointList(points, 0.001);
# ---------- end organizepoints ----------
smaller_3 = SmallerThan(FirstNumber=item_3, SecondNumber=0.01)  # -> flatten(SmallerThan), OrEqualTo
smaller_4 = SmallerThan(FirstNumber=item_4, SecondNumber=0.01)  # -> flatten(SmallerThan), OrEqualTo
move_14 = Move(Geometry=pt_3, Motion=X_2)  # -> Geometry, Transform
reset = Button()
cull_3 = CullPattern(List=pt_5, CullPattern=invert([True, False, False]))
anchor = Anchor(Point=[pt_3, move_14.Geometry], Strength=10000)
data = Data([length_line, cull_2, cull, show, plasticanchor, anchor])
cull_4 = CullPattern(List=hinge_3, CullPattern=smaller_4.SmallerThan)
panel_4 = Panel("""2
8""")
cull_5 = CullPattern(List=hinge_4, CullPattern=smaller_3.SmallerThan)
item_5 = ListItem(List=organizepoints, Index=panel_4, Wrap=True)  # -> simplify(Item)
solver = Solver(GoalObjects=data, Reset=reset, Threshold=1e-15, Tolerance=0.01, On=Toggle(True))  # -> I, V, O
goalsbrancher_2 = CSharpScript(goals=cull_4, Reference="C:\Users\feli2\AppData\Roaming\Grasshopper\Libraries\KangarooSolver.dll")  # -> A; inputs goals: tree; same code as goalsbrancher
pt_7 = Point([item_5, pt_5])
move_15 = Move(Geometry=pt_7, Motion=X_3)  # -> Geometry, Transform
move_16 = Move(Geometry=move_15.Geometry, Motion=Z)  # -> Geometry, Transform
anchor_2 = Anchor(Point=[pt_7, move_16.Geometry], Strength=10000)
reset_2 = Button()
data_2 = Data([length_line_2, show_2, plasticanchor_2, anchor_2, cull_5, cull_4])
solver_2 = Solver(GoalObjects=data_2, Reset=reset_2, Threshold=1e-15, Tolerance=0.01, On=Toggle(True))  # -> I, V, O
